% Simulink data dictionary fbw_data.sldd

base_data_computed = Simulink.Bus()
  on_ground: double

base_raw = Simulink.Bus()
  data: Bus: base_raw_data
  input: Bus: base_input
  output: Bus: base_output

base_pitch_integrated = Simulink.Bus()
  eta_pos: double

base_pitch_law_output = Simulink.Bus()
  eta_dot_pos_s: double

base_pitch_normal = Simulink.Bus()
  Cstar_c_g: double
  Cstar_g: double
  eta_dot_pos_s: double

base_pitch_output = Simulink.Bus()
  eta_pos: double
  iH_deg: double

base_roll_data_computed = Simulink.Bus()
  in_flight: double
  in_flight_gain: double

base_roll_normal = Simulink.Bus()
  pk_c_deg_s: double
  Phi_c_deg: double
  xi_pos: double

base_roll_output = Simulink.Bus()
  xi_pos: double

fbw_input = Simulink.Bus()
  data: Bus: base_raw_data
  input: Bus: base_input

base_pitch_protection = Simulink.Bus()
  attitude_min: Bus: base_pitch_law_output
  attitude_max: Bus: base_pitch_law_output

base_pitch = Simulink.Bus()
  data_computed: Bus: base_pitch_data_computed
  law_normal: Bus: base_pitch_normal
  law_protection: Bus: base_pitch_protection
  vote: Bus: base_pitch_law_output
  integrated: Bus: base_pitch_integrated
  output: Bus: base_pitch_output

base_roll = Simulink.Bus()
  data_computed: Bus: base_roll_data_computed
  law_normal: Bus: base_roll_normal
  output: Bus: base_roll_output

base_sim = Simulink.Bus()
  raw: Bus: base_raw
  data: Bus: base_data
  data_computed: Bus: base_data_computed
  input: Bus: base_input

fbw_output = Simulink.Bus()
  sim: Bus: base_sim
  pitch: Bus: base_pitch
  roll: Bus: base_roll

base_input = Simulink.Bus()
  delta_eta_pos: double
  delta_xi_pos: double
  delta_zeta_pos: double

base_raw_data = Simulink.Bus()
  nz_g: double
  Theta_deg: double
  Phi_deg: double
  qk_rad_s: double
  rk_rad_s: double
  pk_rad_s: double
  q_dot_rad_s2: double
  r_dot_rad_s2: double
  p_dot_rad_s2: double
  iH_deg: double
  Vk_kt: double
  radio_height_ft: double
  CG_percent_MAC: double
  gear_animation_pos_0: double
  gear_animation_pos_1: double
  gear_animation_pos_2: double
  flaps_handle_index: double

base_data = Simulink.Bus()
  nz_g: double
  Theta_deg: double
  Phi_deg: double
  qk_deg_s: double
  rk_deg_s: double
  pk_deg_s: double
  qk_dot_deg_s2: double
  rk_dot_deg_s2: double
  pk_dot_deg_s2: double
  iH_deg: double
  Vk_kt: double
  radio_height_ft: double
  CG_percent_MAC: double
  gear_strut_compression_0: double
  gear_strut_compression_1: double
  gear_strut_compression_2: double
  flaps_handle_index: double

base_output = Simulink.Bus()
  eta_pos: double
  iH_deg: double
  iH_deg_should_write: double
  xi_pos: double
  zeta_pos: double

base_pitch_data_computed = Simulink.Bus()
  in_flight: double
  in_flare: double
  in_flight_gain: double
  iH_deg_should_freeze: double
  iH_deg_reset: double
  iH_deg_reset_deg: double
  iH_deg_should_write: double
  iH_deg_rate_limit_up_deg_s: double
  iH_deg_rate_limit_lo_deg_s: double